# Grasshopper definition ABB_01_External axis.gh (Grasshopper 1.0.7)
# plug-ins: Robots, tasCore, tasMachine

# ---- group: Robot and tool loading
path = FilePath("C:\data\ABB_Tools\HSD_Spindle.xml")
c_script = CSharpScript(Path_P=path, TCP_Offset_Offset="46.1")  # -> out, Tool_Name_TN, TCP, Weight_W, Centroid_Cen, Mesh_M; inputs Path_P: String, TCP_Offset_Offset: Double
# ---------- c_script: C# ----------
    string name = "Default";
    Plane tcp = Plane.WorldXY;
    double weight = 0.0;
    Point3d centroid = Point3d.Origin;
    Mesh m = new Mesh();

    // load file

    var element = System.Xml.Linq.XElement.Load(P);
    if (element == null) return;
    if (element.Name.LocalName != "tool")
    {
      Print("Invalid tool file.");
      return;
    }

    var temp = element.Elements(System.Xml.Linq.XName.Get("name")).First();
    name = temp.Value;

    temp = element.Elements(System.Xml.Linq.XName.Get("weight")).First();
    weight = double.Parse(temp.Value);

    temp = element.Elements(System.Xml.Linq.XName.Get("centroid")).First();
    centroid = StringToPoint(temp.Value);

    temp = element.Elements(System.Xml.Linq.XName.Get("tcp")).First();
    var sub = temp.Elements(System.Xml.Linq.XName.Get("loc")).First();
    Point3d loc = StringToPoint(sub.Value);

    sub = temp.Elements(System.Xml.Linq.XName.Get("rot")).First();
    Quaternion rot = StringToQuaternion(sub.Value);

    rot.GetRotation(out tcp);
    tcp.Origin = loc - tcp.ZAxis * Offset;

    // get mesh
    temp = element.Elements(System.Xml.Linq.XName.Get("mesh")).First();
    string mesh_path = temp.Value;
    string dir = System.IO.Path.GetDirectoryName(P);

    TCP = tcp;
    TN = name;
    W = weight;
    Cen = centroid;
    M = GetMeshFrom3dm(System.IO.Path.Combine(dir, mesh_path));
# ---------- c_script: C# additional code ----------
  Quaternion StringToQuaternion(string s)
  {
    string[] bits = s.Split();
    if (bits.Length != 4) return Quaternion.Identity;

    Quaternion q = new Quaternion();

    q.A = double.Parse(bits[0]);
    q.B = double.Parse(bits[1]);
    q.C = double.Parse(bits[2]);
    q.D = double.Parse(bits[3]);

    return q;
  }

  Point3d StringToPoint(string s)
  {
    string[] bits = s.Split();
    if (bits.Length != 3) return Point3d.Origin;

    double x = double.Parse(bits[0]);
    double y = double.Parse(bits[1]);
    double z = double.Parse(bits[2]);


    return new Point3d(x, y, z);
  }

  Mesh GetMeshFrom3dm(string path)
  {
    Rhino.FileIO.File3dm file = Rhino.FileIO.File3dm.Read(path);

    Mesh m = new Mesh();

    for (int i = 0; i < file.Objects.Count; ++i)
    {
      if (file.Objects[i].Geometry is Mesh)
      {
        m.Append(file.Objects[i].Geometry as Mesh);
      }
    }

    return m;
  }
# ---------- end c_script ----------
tool = CreateTool(
    Name=c_script.Tool_Name_TN,
    TCP=c_script.TCP,
    Weight=c_script.Weight_W,
    Centroid=c_script.Centroid_Cen,
    Mesh=c_script.Mesh_M)  # -> Tool, TCP

list = ValueList({"Bartlett-IRB120", "Bartlett-IRB1600", "Bartlett-KR6", "Bartlett-KR60", "Bartlett-UR10", "CITA-IRB1600-145 + Turntable", "CITA-IRB1600-145 + IRB140", "CITA-IRB1600-145", "CITA-IRB140"}, selected="CITA-IRB1600-145 + Turntable")
load_robot = LoadRobotSystem(Name=list, Base=PlaneXY(0, 0, 0))
tool_2 = ToolParameter(tool.Tool)

# ---- group: Targets
xy = XYPlane(Origin=[<geometry referenced from the Rhino model> x3])
oripoly = OrientedPolyline(Data=xy)
tastp_orient_targets = TasToolpathOrientTargets(Targets=oripoly, Point=Point(0, 0, 0), Twist=Slider(1, range=-3.14..1))  # -> Targets, Debug
deoripoly = DeconstructOrientedPolyline(OrientedPolyline=tastp_orient_targets.Targets)

# ----
rad = Radians(Degrees=Slider(-90, range=-180..180))
rad_2 = Radians(Degrees=Slider(49, range=-180..180))
rad_3 = Radians(Degrees=Slider(43, range=-180..180))
rad_4 = Radians(Degrees=Slider(-7, range=-180..180))
rad_5 = Radians(Degrees=Slider(6, range=-180..180))
rad_6 = Radians(Degrees=Slider(-2, range=-180..180))
xy_2 = XYPlane(Origin=<geometry referenced from the Rhino model>)
format = Format(
    Format="{0}, {1}, {2}, {3}, {4}, {5}",
    Culture=127,
    Data0=rad,
    Data1=rad_2,
    Data2=rad_3,
    Data3=rad_4,
    Data4=rad_5,
    Data5=rad_6)
frame = CreateFrame(Plane=xy_2, CoupledMechanicalGroup=-1, CoupledMechanism=-1)

# ---- group: Activate external unit and give initial value to external axis
customcmd = CustomCommand(Name="Custom command", ABBCode="ActUnit M7DM1;")

# ----
target = CreateTarget(Joints=format, External="0,0", IsCartesian=False)

# ---- group: External axis values hack
panel = Panel("""30
60
0""")

# ----
rad_7 = Radians(Degrees=panel)

# ---- group: External axis values hack (continued)
format_2 = Format(Format="0,{0}", Culture=127, Data0=rad_7)

# ---- group: Target generation
list_2 = ValueList({"Joint", "Linear"}, selected="Linear")
target_2 = CreateTarget(Plane=deoripoly, Motion=list_2, Tool=tool_2, Frame=frame, External=format_2, IsCartesian=True)

# ----
merge = Merge(Data1=target, Data2=target_2)  # -> flatten(Result)
panel_2 = Panel(target_2)

# ---- group: DO it
program = CreateProgram(Name="DefaultProgram", RobotSystem=load_robot, Targets1=merge, InitCommands=customcmd, StepSize=1)  # -> Program, Code, Duration, Warnings, Errors
sim = ProgramSimulation(Program=program.Program, Time=Slider(0.101, range=0..1), Normalized=True)  # -> SystemMeshes, JointRotations, Plane, Index, Time, Program, Errors

# ----
panel_3 = Panel(program.Code)
