# Grasshopper definition 01_Basic_Move.gh (Grasshopper 1.0.7)
# plug-ins: Robots

# ----
# Target Creation
origin = Origin(Point(12.89207834, -580.2731945, 500.6324469))
xz_plane = XZPlane(Origin=origin)
create_target = CreateTarget(Plane=xz_plane, IsCartesian=True)
target_parameter = TargetParameter(create_target)

# ----
# System Definition
list = ValueList({"AA-KR60", "AA-KR30", "AA-KR60_KR30", "AARCH IRB120", "AARCH IRB6620", "Bartlett-IRB120", "Bartlett-IRB1600", "Bartlett-KR6", "Bartlett-KR60", "Bartlett-UR10"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}, selected="CITALab-UR5e")
load_robot_system = LoadRobotSystem(Name=list, Base=PlaneXY(0, 0, 0))

# ----
# Program Creation
create_program = CreateProgram(Name="DefaultProgram", RobotSystem=load_robot_system, Targets1=target_parameter, StepSize=1)  # -> Program, Code, Duration, Warnings, Errors
# Visualisation
kinematics = Kinematics(RobotSystem=load_robot_system, Target=target_parameter, DisplayGeometry=True)  # -> Meshes, Joints, Planes, Errors
panel = Panel(create_program.Code)
