# Grasshopper definition 02_Linerar_Movement.gh (Grasshopper 1.0.7)
# plug-ins: Robots

# ----
# Targets Creation
curve = Curve(<curve referenced from the Rhino model>)
divide_curve = DivideCurve(Curve=curve, Count=10, Kinks=False)  # -> Points, Tangents, Parameters
xy_plane = XYPlane(Origin=divide_curve.Points)
unit_z = UnitZ(Factor=-1)
adjust_plane = AdjustPlane(Plane=xy_plane, Normal=unit_z)
create_target = CreateTarget(Plane=adjust_plane, IsCartesian=True)
target_parameter = TargetParameter(create_target)

# ----
# System Definition
list = ValueList({"AA-KR60", "AA-KR30", "AA-KR60_KR30", "AARCH IRB120", "AARCH IRB6620", "Bartlett-IRB120", "Bartlett-IRB1600", "Bartlett-KR6", "Bartlett-KR60", "Bartlett-UR10"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}, selected="CITALab-UR5e")
load_robot_system = LoadRobotSystem(Name=list, Base=PlaneXY(0, 0, 0))

# ----
# Program Creation
create_program = CreateProgram(Name="DefaultProgram", RobotSystem=load_robot_system, Targets1=target_parameter, StepSize=1)  # -> Program, Code, Duration, Warnings, Errors

# ----
# Simulation
number_slider = Slider(0, range=0..1)
program_simulation = ProgramSimulation(Program=create_program.Program, Time=number_slider, Normalized=True)  # -> SystemMeshes, JointRotations, Plane, Index, Time, Program, Errors

panel = Panel(create_program.Code)
