# Grasshopper definition 03_Target_Parameters.gh (Grasshopper 1.0.7)
# plug-ins: Robots

unit_z = UnitZ(Factor=1)
curve = Curve(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)
value_list = ValueList({"AA-KR60", "AA-KR30", "AA-KR60_KR30", "AARCH IRB120", "AARCH IRB6620", "Bartlett-IRB120", "Bartlett-IRB1600", "Bartlett-KR6", "Bartlett-KR60", "Bartlett-UR10"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}, selected="KULeuven-UR5")
perp_frames = PerpFrames(Curve=curve, Count=10, Align=unit_z)  # -> Frames, Parameters
load_robot_system = LoadRobotSystem(Name=value_list, Base=PlaneXY(0, 0, 0))
value_list_2 = ValueList({"Joint", "Linear"}, selected="Linear")
create_target = CreateTarget(Plane=perp_frames.Frames, Motion=value_list_2, Speed="50", Zone="10", IsCartesian=True)
create_program = CreateProgram(Name="DefaultProgram", RobotSystem=load_robot_system, Targets1=create_target, StepSize=1)  # -> Program, Code, Duration, Warnings, Errors
program_simulation = ProgramSimulation(Program=create_program.Program, Time=Slider(0, range=0..1), Normalized=True)  # -> SystemMeshes, JointRotations, Plane, Index, Time, Program, Errors
