# Grasshopper definition 04_Simple_Gripper.gh (Grasshopper 1.0.7)
# plug-ins: Robots

# ---- group: Tool setting
# Tool Creation
geometry = Geometry(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)
bounding_box = BoundingBox(Content=geometry, Plane=PlaneXY(0, 0, 0), UnionBox=True)  # -> Box, Box_2
deconstruct_brep = DeconstructBrep(Brep=bounding_box.Box)  # -> Faces, Edges, Vertices
list_item = ListItem(List=deconstruct_brep.Faces, Index=5, Wrap=True)
area = Area(Geometry=list_item)  # -> Area, Centroid
mesh_brep = MeshBrep(
    Brep=geometry,
    Settings={GridMaxCount=0, GridMinCount=16, JaggedSeams=False, MaxEdgeLength=0, MinEdgeLength=0.0001, MinTolerance=0, Refine=True, RefineAngle=0, RelativeTolerance=0.65, SimplePlanes=True, Tolerance=0})
xy_plane = XYPlane(Origin=area.Centroid)
create_tool = CreateTool(Name="Gripper_001", TCP=xy_plane, Weight="5", Mesh=mesh_brep)  # -> Tool, TCP

# ----
# Targets Creation
curve = Curve(<curve referenced from the Rhino model>)
divide_curve = DivideCurve(Curve=curve, Count=10, Kinks=False)  # -> Points, Tangents, Parameters
xy_plane_2 = XYPlane(Origin=divide_curve.Points)
unit_z = UnitZ(Factor=-1)
adjust_plane = AdjustPlane(Plane=xy_plane_2, Normal=unit_z)
create_target = CreateTarget(Plane=adjust_plane, Tool=create_tool.Tool, IsCartesian=True)
target_parameter = TargetParameter(create_target)

# ----
# System Definition
list = ValueList({"AA-KR60", "AA-KR30", "AA-KR60_KR30", "AARCH IRB120", "AARCH IRB6620", "Bartlett-IRB120", "Bartlett-IRB1600", "Bartlett-KR6", "Bartlett-KR60", "Bartlett-UR10"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}, selected="CITALab-UR5e")
load_robot_system = LoadRobotSystem(Name=list, Base=PlaneXY(0, 0, 0))

# ----
# Program Creation
create_program = CreateProgram(Name="DefaultProgram", RobotSystem=load_robot_system, Targets1=target_parameter, StepSize=1)  # -> Program, Code, Duration, Warnings, Errors

# ----
# Simulation
number_slider = Slider(0, range=0..1)
program_simulation = ProgramSimulation(Program=create_program.Program, Time=number_slider, Normalized=True)  # -> SystemMeshes, JointRotations, Plane, Index, Time, Program, Errors

panel = Panel(create_program.Code)
