# Grasshopper definition 05_Command_Control.gh (Grasshopper 1.0.7)
# plug-ins: Robots

# ----
# System Definition
list = ValueList({"AA-KR60", "AA-KR30", "AA-KR60_KR30", "AARCH IRB120", "AARCH IRB6620", "Bartlett-IRB120", "Bartlett-IRB1600", "Bartlett-KR6", "Bartlett-KR60", "Bartlett-UR10"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}, selected="CITALab-UR5e")
load_robot_system = LoadRobotSystem(Name=list, Base=PlaneXY(0, 0, 0))

set_do = SetDO(DO=Slider(7, range=0..10), Value=Toggle(True))
set_do_2 = SetDO(DO=Slider(7, range=0..10), Value=Toggle(False))

# ----
# Targets Creation
curve = Curve(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)
divide_curve = DivideCurve(Curve=curve, Count=10, Kinks=False)  # -> Points, Tangents, Parameters
xy_plane = XYPlane(Origin=divide_curve.Points)
unit_z = UnitZ(Factor=-1)
adjust_plane = AdjustPlane(Plane=xy_plane, Normal=unit_z)

ghpython_script = GhPythonScript(planes=adjust_plane)  # -> first, rest, last; inputs planes: list of Plane
# ---------- ghpython_script: Python ----------
first = planes[0]

last = planes[-1]

rest = planes[1:-1]
# ---------- end ghpython_script ----------
create_target = CreateTarget(Plane=ghpython_script.last, Command=set_do_2, IsCartesian=True)
create_target_2 = CreateTarget(Plane=ghpython_script.rest, IsCartesian=True)
create_target_3 = CreateTarget(Plane=ghpython_script.first, Command=set_do, IsCartesian=True)
merge = Merge(Data1=create_target_3, Data2=create_target_2, Data3=create_target)

target_parameter = TargetParameter(merge)

# ----
# Program Creation
create_program = CreateProgram(Name="DefaultProgram", RobotSystem=load_robot_system, Targets1=target_parameter, StepSize=1)  # -> Program, Code, Duration, Warnings, Errors

# ----
# Simulation
number_slider = Slider(0, range=0..1)
program_simulation = ProgramSimulation(Program=create_program.Program, Time=number_slider, Normalized=True)  # -> SystemMeshes, JointRotations, Plane, Index, Time, Program, Errors

panel = Panel(create_program.Code)
