# Grasshopper definition 05_Workbase.gh (Grasshopper 1.0.7)
# plug-ins: Robots

# ---- group: Work base / Tool path
number_slider = Slider(200, range=0..1000)
point = Point([Point(603.8736768, -415.8032954, 301.2547732), Point(318.0280664, -98.82561662, 106.830697), Point(261.9132841, -485.8853272, 196.7749501), Point(614.772648, -119.2440661, 220.6591224), Point(401.4301144, -326.4456363, 202.0914013), Point(257.3051201, -266.091792, 132.4245617), Point(407.8751903, -487.5640808, 250.3794285), Point(555.7699495, -281.7186689, 245.5128104), Point(440.5389748, -169.625544, 171.609307), Point(317.3784606, -402.7679646, 193.2620753)])
plane_fit = PlaneFit(Points=point)  # -> Plane, Deviation
list_item = ListItem(List=point, Index=Slider(3, range=0..10), Wrap=True)
negative = Negative(Value=number_slider)
plane_origin = PlaneOrigin(Base=plane_fit.Plane, Origin=list_item)
geometry = Geometry(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)
construct_domain = ConstructDomain(DomainStart=negative, DomainEnd=number_slider)
divide_curve = DivideCurve(Curve=geometry, Count=10, Kinks=False)  # -> Points, Tangents, Parameters
xy_plane = XYPlane(Origin=divide_curve.Points)
rectangle = Rectangle(Plane=plane_origin, XSize=construct_domain, YSize=construct_domain, Radius=0)  # -> Rectangle, Length
rectangle_2 = Rectangle(Plane=PlaneXY(0, 0, 0), XSize=construct_domain, YSize=construct_domain, Radius=0)  # -> Rectangle, Length
polyline = PolyLine(Vertices=xy_plane, Closed=False)
deconstruct_plane = DeconstructPlane(Plane=xy_plane)  # -> Origin, XAxis, YAxis, ZAxis
reverse = Reverse(Vector=deconstruct_plane.XAxis)
construct_plane = ConstructPlane(Origin=deconstruct_plane.Origin, XAxis=reverse, YAxis=deconstruct_plane.YAxis)

# ---- group: Work base / Tool setting
geometry_2 = Geometry(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)
bounding_box = BoundingBox(Content=geometry_2, Plane=PlaneXY(0, 0, 0), UnionBox=True)  # -> Box, Box_2
deconstruct_brep = DeconstructBrep(Brep=bounding_box.Box)  # -> Faces, Edges, Vertices
list_item_2 = ListItem(List=deconstruct_brep.Faces, Index=5, Wrap=True)
area = Area(Geometry=list_item_2)  # -> Area, Centroid
mesh_brep = MeshBrep(
    Brep=geometry_2,
    Settings={GridMaxCount=0, GridMinCount=16, JaggedSeams=False, MaxEdgeLength=0, MinEdgeLength=0.0001, MinTolerance=0, Refine=True, RefineAngle=0, RelativeTolerance=0.65, SimplePlanes=True, Tolerance=0})
xy_plane_2 = XYPlane(Origin=area.Centroid)
create_tool = CreateTool(Name="Gripper_001", TCP=xy_plane_2, Weight="5", Mesh=mesh_brep)  # -> Tool, TCP

# ----
list = ValueList({"CITA-IRB1600-145 + Turntable", "CITA-IRB1600-145 + IRB140", "CITA-IRB1600-145", "CITA-IRB140", "CITALab-UR5e"}, selected="CITALab-UR5e")
load_robot_system = LoadRobotSystem(Name=list, Base=PlaneXY(0, 0, 0))

# ---- group: Work base
value_list = ValueList({"Joint", "Linear"}, selected="Linear")
create_target = CreateTarget(
    Plane=construct_plane,
    Motion=value_list,
    Tool=create_tool.Tool,
    Speed="50",
    Zone="10",
    Frame=plane_origin,
    IsCartesian=True)
create_program = CreateProgram(Name="DefaultProgram", RobotSystem=load_robot_system, Targets1=create_target, StepSize=1)  # -> Program, Code, Duration, Warnings, Errors
program_simulation = ProgramSimulation(Program=create_program.Program, Time=Slider(0, range=0..1), Normalized=True)  # -> SystemMeshes, JointRotations, Plane, Index, Time, Program, Errors
