# Grasshopper definition 06_UR5e_With_Gripper.gh (Grasshopper 1.0.7)
# plug-ins: Robots

origin = Origin(Point(7.090732268e-08, 0, 148.4199949))
# Tool Definition
panel = Panel("Gripper_2F85")
xy_plane = XYPlane(Origin=origin)
mesh = Mesh(<mesh referenced from the Rhino model>)
create_tool = CreateTool(Name=panel, TCP=xy_plane, Weight=0, Mesh=mesh)  # -> Tool, TCP

# ----
# Target Definition
origin_2 = Origin(Point(56.63853487, -534.3600004, 559.2363312))
xz_plane = XZPlane(Origin=origin_2)
create_target = CreateTarget(Plane=xz_plane, Tool=create_tool.Tool, IsCartesian=True)

list = ValueList({"CITA-IRB1600-145 + Turntable", "CITA-IRB1600-145 + IRB140", "CITA-IRB1600-145", "CITA-IRB140", "CITALab-UR5e"}, selected="CITALab-UR5e")
load_robot_system = LoadRobotSystem(Name=list, Base=PlaneXY(0, 0, 0))
create_program = CreateProgram(Name="DefaultProgram", RobotSystem=load_robot_system, Targets1=create_target, StepSize=1)  # -> Program, Code, Duration, Warnings, Errors

# ----
# Visualization
kinematics = Kinematics(RobotSystem=load_robot_system, Target=create_target, DisplayGeometry=True)  # -> Meshes, Joints, Planes, Errors
mesh_2 = Mesh(kinematics.Meshes)

# ----
# Remote Control
panel_2 = Panel("192.168.0.110")
button = Button()
remote_connection = RemoteConnection(Program=create_program.Program, IP=panel_2, Upload=button, Play=button, Pause=False)
