# Grasshopper definition 07_Pick_And_Place.gh (Grasshopper 1.0.7)
# plug-ins: Robots

clearance = Slider(71, range=0..100)

origin = Origin(Point(-0.002384185791, 0.01701743541, 162.2160267))
# Tool Definition
panel = Panel("Gripper_2F85")
xy_plane = XYPlane(Origin=origin)
mesh = Mesh(<mesh referenced from the Rhino model>)
create_tool = CreateTool(Name=panel, TCP=xy_plane, Weight=0, Mesh=mesh)  # -> Tool, TCP

point = Point([<point referenced from the Rhino model> x3])

# ----
# Pickup
origin_2 = Origin(Point(50, -475.594631, 20))
unit_z = UnitZ(Factor=-1)
xy_plane_2 = XYPlane(Origin=origin_2)
# Drop
panel_2 = Panel("rq_close_and_wait()")
unit_z_2 = UnitZ(Factor=clearance)
adjust_plane = AdjustPlane(Plane=xy_plane_2, Normal=unit_z)
move = Move(Geometry=adjust_plane, Motion=unit_z_2)  # -> Geometry, Transform
command = Command(Name="Custom command", URCode=panel_2)
list = ValueList({"Joint", "Linear"}, selected="Linear")
create_target = CreateTarget(Plane=move.Geometry, Motion=list, Tool=create_tool.Tool, IsCartesian=True)
create_target_2 = CreateTarget(Plane=adjust_plane, Motion=list, Tool=create_tool.Tool, Command=command, IsCartesian=True)

unit_z_3 = UnitZ(Factor=clearance)
unit_z_4 = UnitZ(Factor=-1)
xy_plane_3 = XYPlane(Origin=point)
adjust_plane_2 = AdjustPlane(Plane=xy_plane_3, Normal=unit_z_4)
move_2 = Move(Geometry=adjust_plane_2, Motion=unit_z_3)  # -> Geometry, Transform
command_2 = Command(Name="Custom command", URCode="rq_open_and_wait()")
list_2 = ValueList({"Joint", "Linear"}, selected="Linear")
create_target_3 = CreateTarget(Plane=move_2.Geometry, Motion=list_2, Tool=create_tool.Tool, IsCartesian=True)
create_target_4 = CreateTarget(Plane=adjust_plane_2, Motion=list_2, Tool=create_tool.Tool, Command=command_2, IsCartesian=True)
list_3 = ValueList({"CITA-IRB1600-145 + Turntable", "CITA-IRB1600-145 + IRB140", "CITA-IRB1600-145", "CITA-IRB140", "CITALab-UR5e"}, selected="CITALab-UR5e")
ghpython_script = GhPythonScript(pickupEntry=create_target, pickup=create_target_2, dropEntry=create_target_3, drop=create_target_4)  # -> Targets; inputs dropEntry: list, drop: list
# ---------- ghpython_script: Python ----------
Targets = []


for i in range(len(drop)):
    Targets.append(pickupEntry)
    Targets.append(pickup)
    Targets.append(pickupEntry)
    Targets.append(dropEntry[i])
    Targets.append(drop[i])
    Targets.append(dropEntry[i])
# ---------- end ghpython_script ----------
load_robot_system = LoadRobotSystem(Name=list_3, Base=PlaneXY(0, 0, 0))
target_parameter = TargetParameter(ghpython_script)
panel_3 = Panel(ghpython_script)
create_program = CreateProgram(Name="DefaultProgram", RobotSystem=load_robot_system, Targets1=target_parameter, StepSize=1)  # -> Program, Code, Duration, Warnings, Errors

# ----
# Simulation
number_slider = Slider(0, range=0..1)
program_simulation = ProgramSimulation(Program=create_program.Program, Time=number_slider, Normalized=True)  # -> SystemMeshes, JointRotations, Plane, Index, Time, Program, Errors
mesh_2 = Mesh(program_simulation.SystemMeshes)

panel_4 = Panel("C:\Users\Ayoub\Nextcloud\04_Teaching\CITA Robotic Workshop 2019\03_GH_Workflows\01_UR")

# ----
# Remote Control
panel_5 = Panel("192.168.0.110")
button = Button()
remote_connection = RemoteConnection(Program=create_program.Program, IP=panel_5, Upload=button, Play=button, Pause=Button())

save_program = SaveProgram(Program=create_program.Program, Folder=panel_4)
panel_6 = Panel(create_program.Code)
