# Grasshopper definition 08_GetRobotPos.gh (Grasshopper 1.0.7)
# plug-ins: Robots, gHowl

list = ValueList({"CITA-IRB1600-145 + Turntable", "CITA-IRB1600-145 + IRB140", "CITA-IRB1600-145", "CITA-IRB140", "CITALab-UR5e"}, selected="CITALab-UR5e")
udp_receiver = UDPReceiver(Address="192.168.0.100", Port="1991", Pattern=0)  # -> Info, Data
load_robot_system = LoadRobotSystem(Name=list, Base=PlaneXY(0, 0, 0))
ghpython_script = GhPythonScript(x=udp_receiver.Data)  # -> a
# ---------- ghpython_script: Python ----------
a = x[1:-1]
# ---------- end ghpython_script ----------
panel = Panel(udp_receiver.Data)
create_target = CreateTarget(Joints=ghpython_script, IsCartesian=False)
panel_2 = Panel(ghpython_script)
kinematics = Kinematics(RobotSystem=load_robot_system, Target=create_target, DisplayGeometry=True)  # -> Meshes, Joints, Planes, Errors
